# Dynamo graph Building walls from floor edges.dyn (Dynamo 1.2.2.373)

wall_types = WallTypes("aaaaaa")
categories = Categories("Floors")
all_elements_of_category = ElementsOfCategory(categories)
levels = Levels("Level 2")
all_elements_at_level = ElementsAtLevel(levels)
setIntersection = SetIntersection(all_elements_of_category@L2, all_elements_at_level@L2)
geometry = Element.Geometry(setIntersection)
flatten = Flatten(geometry)
centroid = Solid.Centroid(geometry)
flatten_2 = Flatten(centroid)
ZAxis = Vector.ZAxis()
byOriginNormal = Plane.ByOriginNormal(origin=flatten_2, normal=ZAxis)
intersect = Geometry.Intersect(geometry=flatten, other=byOriginNormal)
perimeterCurves = Surface.PerimeterCurves(intersect)
flatten_3 = Flatten(perimeterCurves)
python_script = Python(IN[0]=wall_types, IN[1]=flatten_3, IN[2]=levels)
# ---------- python_script.python (40 lines) ----------
import clr

clr.AddReference('RevitAPI')
from Autodesk.Revit.DB import *
from Autodesk.Revit.DB.Structure import *

clr.AddReference("System")
from System.Collections.Generic import List

clr.AddReference('RevitNodes')
import Revit
clr.ImportExtensions(Revit.GeometryConversion)
clr.ImportExtensions(Revit.Elements)

clr.AddReference('RevitServices')
import RevitServices
from RevitServices.Persistence import DocumentManager
from RevitServices.Transactions import TransactionManager

import System

doc = DocumentManager.Instance.CurrentDBDocument
uiapp = DocumentManager.Instance.CurrentUIApplication
app = uiapp.Application

slabedges = []

slabedgetype = IN[0]
curves = System.Array[Curve]([c.ToRevitType(True) for c in IN[1]])
level = IN[2]

for idx in range(0,len(curves)):
	TransactionManager.Instance.EnsureInTransaction(doc)
	
	#slabedge = doc.Create.NewSlabEdge.Overloads[SlabEdgeType, System.Array[Reference]](UnwrapElement(slabedgetype[idx]), references)
	slabedge = Wall.Create(doc,curves[idx], ElementId(level.Id), True)
	TransactionManager.Instance.TransactionTaskDone()
	slabedges.append(slabedge)
	
OUT = Reference
# ----------------------------------------
