# Dynamo graph Structural Framing Opening for Ductswork - link.dyn (Dynamo 0.9.2.4472)

# group: Get the intersection points
categories = Categories("StructuralFraming")
# note: (C) Copyright 2016-2017 by BIM Oasis Inc.
# Permission to use, copy, modify, and distribute this software in
# object code form for any purpose and without fee is hereby granted,
# provided that the above copyright notice appears in all copies and
# that both that copyright notice and the limited warranty and
# restricted rights notice below appear in all supporting
# documentation.
# BIM Oasis PROVIDES THIS PROGRAM "AS IS" AND WITH ALL FAULTS.
# BIM Oasis SPECIFICALLY DISCLAIMS ANY IMPLIED WARRANTY OF
# MERCHANTABILITY OR FITNESS FOR A PARTICULAR USE. BIM Oasis,INC.
# DOES NOT WARRANT THAT THE OPERATION OF THE PROGRAM WILL BE
# UNINTERRUPTED OR ERROR FREE.
all_elements_of_category = ElementsOfCategory(categories)
# note: BIM Oasis Copyright
# For more details please visit us at:
# https://www.facebook.com/BIMOasis
geometry = Element.Geometry(all_elements_of_category)
flatten = Flatten(geometry)
get_all_ducts_from_link = Python()
# ---------- get_all_ducts_from_link.python (37 lines) ----------
import clr

clr.AddReference('RevitAPI')
from Autodesk.Revit.DB import *
from Autodesk.Revit.DB.Structure import *

clr.AddReference("System")
from System.Collections.Generic import List

clr.AddReference('RevitNodes')
import Revit
clr.ImportExtensions(Revit.GeometryConversion)
clr.ImportExtensions(Revit.Elements)

clr.AddReference('RevitServices')
import RevitServices
from RevitServices.Persistence import DocumentManager
from RevitServices.Transactions import TransactionManager
import itertools

elementlist = []

doc = DocumentManager.Instance.CurrentDBDocument
linkdocs =  DocumentManager.Instance.CurrentUIApplication.Application.Documents	

#looks for links in the active project, add instances to a list
for linkdoc in linkdocs:
	if linkdoc.IsLinked:
		collector = FilteredElementCollector(linkdoc)
		filter = ElementCategoryFilter(BuiltInCategory.OST_DuctCurves)
		elementlist.append(collector.WherePasses(filter).WhereElementIsNotElementType().ToElements())

#for elem in elementlist:
#	options = Options()
#	elem.get_Geometry(options)
	
OUT = list(itertools.chain(*elementlist))
# ----------------------------------------
geometry_2 = Element.Geometry(get_all_ducts_from_link)
flatten_2 = Flatten(geometry_2)
intersect = Geometry.Intersect(geometry=flatten, other=flatten_2, lacing=CrossProduct)
flatten_3 = Flatten(intersect)
centroid = Solid.Centroid(flatten_3)

# group: Get the corresponding intersected beams
boundingBox = Geometry.BoundingBox(flatten)
contains = BoundingBox.Contains(boundingBox, centroid, lacing=CrossProduct)
transpose = List.Transpose(contains)
boolean = BoolSelector(true)
indexOf = IndexOf(arg1=boolean)
map = List.Map(list=transpose, f_x=indexOf)
getItemAtIndex = List.GetItemAtIndex(list=all_elements_of_category, index=map)

# group: Get the corresponding intersected ducts
boundingBox_2 = Geometry.BoundingBox(flatten_2)
contains_2 = BoundingBox.Contains(boundingBox_2, centroid, lacing=CrossProduct)
transpose_2 = List.Transpose(contains_2)
boolean_2 = BoolSelector(true)
indexOf_2 = IndexOf(arg1=boolean_2)
map_2 = List.Map(list=transpose_2, f_x=indexOf_2)
getItemAtIndex_2 = List.GetItemAtIndex(list=get_all_ducts_from_link, index=map_2)

# group: Create the boundaries of the intersections
geometry_3 = Element.Geometry(getItemAtIndex_2)
flatten_4 = Flatten(geometry_3)
location = StructuralFraming.Location(getItemAtIndex)
byLineAndPoint = Plane.ByLineAndPoint(location, centroid)
flatten_5 = Flatten(byLineAndPoint)
intersect_2 = Geometry.Intersect(geometry=flatten_4, other=flatten_5)
flatten_6 = Flatten(intersect_2)
perimeterCurves = Surface.PerimeterCurves(flatten_6)

python_script = Python(IN[0]=getItemAtIndex, IN[1]=perimeterCurves)
# ---------- python_script.python (47 lines) ----------
import clr

clr.AddReference('RevitAPI')
from Autodesk.Revit.DB import *
from Autodesk.Revit.DB.Structure import *
from Autodesk.Revit.Creation import *

clr.AddReference("System")
from System.Collections.Generic import List

clr.AddReference('RevitNodes')
import Revit
clr.ImportExtensions(Revit.GeometryConversion)
clr.ImportExtensions(Revit.Elements)

clr.AddReference('RevitServices')
import RevitServices
from RevitServices.Persistence import DocumentManager
from RevitServices.Transactions import TransactionManager

import math

doc = DocumentManager.Instance.CurrentDBDocument

openings = []

beams = IN[0]
loops = IN[1]

for i in range(0,len(beams)):
		
	el = doc.GetElement(ElementId(beams[i].Id))
		
	ca = CurveArray()
		
	for c in loops[i]:
			
		curve1 = c.ToRevitType(True)
		ca.Append(curve1)
						
	TransactionManager.Instance.EnsureInTransaction(doc)
	opening = doc.Create.NewOpening.Overloads[Element, CurveArray, eRefFace](el, ca, eRefFace.CenterY)
	TransactionManager.Instance.TransactionTaskDone()	
					
	openings.append(ca)

OUT = openings
# ----------------------------------------
